# Dynamo graph CriarBiancoGres.dyn (Dynamo 2.3.0.5885)
# packages: Orchid 230.0.1.7346, Genius Loci 2020.2.24, Genius Loci 2020.3.24

# group: Excel Here is how i read the excel file, everything works.
file_path = Filename("..\BG-Scrapy.xlsx")
file_from_path = FileObject(path=file_path)
code_block = CodeBlock { "Planilha1"; }
boolean = BoolSelector(true)
importExcel = Data.ImportExcel(file=file_from_path, sheetName=code_block, showExcel=boolean)
transpose = List.Transpose(lists=importExcel)
code_block_2 = CodeBlock { 0; }
removeItemAtIndex = List.RemoveItemAtIndex(list=transpose, indices=code_block_2, lacing=Longest)

boolean_2 = BoolSelector(true)
clean = List.Clean(list=removeItemAtIndex, preserveIndices=boolean_2)
code_block_3 = CodeBlock(thumb=clean) { thumb[2]; }
code_block_4 = CodeBlock(name=clean) { name[0]; }
unique_names = Python(IN[0]=code_block_4)
# ---------- unique_names.python (17 lines) ----------
# Carregar as bibliotecas DesignScript e padrão do Python
import sys
import clr
clr.AddReference('ProtoGeometry')
from Autodesk.DesignScript.Geometry import *

names = IN[0]

uniqueNames = []

for i, v in enumerate(names):
    totalcount = names.count(v)
    count = names[:i].count(v)
    uniqueNames.append(v + str(count + 1) if totalcount > 1 else v)


OUT = uniqueNames
# ----------------------------------------
directory_path = Directory("C:\Users\55279\Desktop\bianco2")
download_image_thumbs = Python(IN[0]=code_block_3, IN[1]=unique_names, IN[2]=directory_path)
# ---------- download_image_thumbs.python (22 lines) ----------
import sys
sys.path.append('C:\Program Files (x86)\IronPython 2.7\Lib')
#from urllib import urlretrieve

import urllib

import os, ssl
if (not os.environ.get('PYTHONHTTPSVERIFY', '') and getattr(ssl, '_create_unverified_context', None)):
	ssl._create_default_https_context = ssl._create_unverified_context


thumb_url = [urllib.quote(t, safe=':/') for t in IN[0]]
thumb_name = IN[1]
thumb_dir = IN[2] 

thumb_file = []

for turl, tname in zip(thumb_url, thumb_name):
	urllib.urlretrieve(turl, thumb_dir + "\\" + tname + '.jpg')
	thumb_file.append(thumb_dir + "\\" + tname + '.jpg')

OUT = thumb_file
# ----------------------------------------
create = Orchid.RevitMaterial.Material.Create(name=unique_names)
boolean_3 = BoolSelector(true)
code_block_5 = CodeBlock { 100; 0; 0; 0; }
byARGB = Color.ByARGB(a=code_block_5.out0, r=code_block_5.out1, g=code_block_5.out2, b=code_block_5.out3)
code_block_6 = CodeBlock(tamanho=clean) { tamanho[3]; }
size_separator = Python(IN[0]=code_block_6)
# ---------- size_separator.python (35 lines) ----------
# Carregar as bibliotecas DesignScript e padrão do Python
import sys
import clr


pyt_path = r'C:\Program Files (x86)\IronPython 2.7\Lib'
sys.path.append(pyt_path)

from string import *

clr.AddReference('ProtoGeometry')
from Autodesk.DesignScript.Geometry import *

clr.AddReference("RevitAPIUI")
from Autodesk.Revit.UI import TaskDialog

clr.AddReference("DSCoreNodes")
import DSCore
from DSCore import *

import re

xsep = "X"

input_string = IN[0]
single_size = []
multi_size = []
msize = []

for key, i in enumerate(input_string):
	i = i.replace(",", ".")
	element_size = re.split("[x X]", i)
	single_size.append([i, element_size])
		
OUT = single_size
# ----------------------------------------
code_block_7 = CodeBlock { 0; }
fillpattern_create_model = Python(IN[0]=size_separator, IN[1]=code_block_7)
# ---------- fillpattern_create_model.python (71 lines) ----------
import clr
clr.AddReference('ProtoGeometry')
from Autodesk.DesignScript.Geometry import *

# Import ToDSType(bool) extension method
clr.AddReference("RevitNodes")
import Revit
clr.ImportExtensions(Revit.Elements)

# Import DocumentManager and TransactionManager
clr.AddReference("RevitServices")
import RevitServices
from RevitServices.Persistence import DocumentManager
from RevitServices.Transactions import TransactionManager

import System
from System.Collections.Generic import *

# Import RevitAPI
clr.AddReference("RevitAPI")
import Autodesk
from Autodesk.Revit.DB import *

# Start Transaction
doc = DocumentManager.Instance.CurrentDBDocument
TransactionManager.Instance.EnsureInTransaction(doc)

# Unit Conversion

#UIunit = Document.GetUnits(doc).GetFormatOptions(UnitType.UT_Length).DisplayUnits
UIunit = DisplayUnitType.DUT_CENTIMETERS
UIangle = Document.GetUnits(doc).GetFormatOptions(UnitType.UT_Angle).DisplayUnits	

# INPUT

input_size = IN[0]
target = FillPatternTarget.Model
orientation = FillPatternHostOrientation.ToView
angle = UnitUtils.ConvertToInternalUnits(IN[1], UIangle)

spa = []

patnames = []
spacing1 = []
spacing2 = []

collector = FilteredElementCollector(doc).OfClass(FillPatternElement).ToElements()

for sname in input_size:
	patnames.append(str(sname[0]))
	spacing1.append(sname[1][0])
	spacing2.append(sname[1][1])

for pname, spa1, spa2, col in zip(patnames, spacing1, spacing2, collector):
		spac1 = UnitUtils.ConvertToInternalUnits(float(spa1), UIunit)
		spac2 = UnitUtils.ConvertToInternalUnits(float(spa2), UIunit)
		
		existentPat = Element.Name.GetValue(col)
		if pname != existentPat:
			patName = str(pname)
		else:
			patName = existentPat
		
		cfp = FillPattern(patName, target, orientation, angle, spac1, spac2)
		cfpe = FillPatternElement.Create(doc, cfp)		

# Wrap End Transaction
TransactionManager.Instance.TransactionTaskDone()

# Wrap
OUT = patnames
# ----------------------------------------
set = Orchid.RevitMaterial.Graphics.Set(material=create, useRenderAppearance=boolean_3, shadingColor=byARGB, surfaceForegroundPatternColor=byARGB, surfaceBackgroundPattern=fillpattern_create_model)
appearance_schema = AppearanceSchema("Generic")
appearanceasset_create = Custom[AppearanceAsset Create](Name=unique_names, schema=appearance_schema)  # package Genius Loci; Works only in Revit 2018.1 and later. Create an AppearanceAsset by duplicating an existing rendering asset. Please note : The asset will be duplicated with all its properties (category, color, image...)
setAsset = Orchid.RevitMaterial.Material.SetAsset(material=set, appearanceAsset=appearanceasset_create)
code_block_8 = CodeBlock { "Cerâmica"; }
setClass = Orchid.RevitMaterial.Material.SetClass(material=setAsset, name=code_block_8, lacing=Longest)
material_get_appearanceasset = Custom[Material Get AppearanceAsset](material=setClass)  # package Genius Loci; Works only in Revit 2018.1 and later. Retrieves the AppearanceAsset Elements of the given material and its Rendering Asset.
code_block_9 = CodeBlock(nome=clean, tamanho=clean, categoria=clean, acabamento=clean, relevo=clean, classe_ad=clean, variacao_tonalidade=clean, n_faces=clean, espessura=clean, junta=clean, m2_caixa=clean, pecas_caixa=clean)
# ---------- code_block_9.designscript (12 lines) ----------
nome[0];
tamanho[3];
categoria[4];
acabamento[5];
relevo[6];
classe_ad[7];
variacao_tonalidade[8];
n_faces[9];
espessura[10];
junta[11];
m2_caixa[12];
pecas_caixa[13];
# ----------------------------------------
material_appenddescription = Python(IN[0]=code_block_9.out0, IN[1]=code_block_9.out1, IN[2]=code_block_9.out2, IN[3]=code_block_9.out3, IN[4]=code_block_9.out4, IN[5]=code_block_9.out5, IN[6]=code_block_9.out6, IN[7]=code_block_9.out7, IN[8]=code_block_9.out8, IN[9]=code_block_9.out9, IN[10]=code_block_9.out10)
# ---------- material_appenddescription.python (43 lines) ----------
# Carregar as bibliotecas DesignScript e padrão do Python
import sys
import clr
clr.AddReference('ProtoGeometry')
from Autodesk.DesignScript.Geometry import *
#from itertools import izip_longest

header_list = ["", "Cerâmica Biancogres ", "Categoria: ", "Acabamento: ", "Relevo: ", "Classe AD: ", "Variação/Tonalidade: ", "Nº Faces: ", "Espessura: ", "Junta: ", "m² por caixa: ", "Peças por caixa: "]
    
nome = IN[0]
tamanho = IN[1]
categoria = IN[2]
acabamento = IN[3]
relevo = IN[4]
classe_ad = IN[5]
variacao_tonalidade = IN[6]
n_faces = IN[7]
espessura = IN[8]
junta = IN[9]
m2_caixa = IN[10]
pecas_caixa = IN[11]

infos = zip(nome, tamanho, categoria, acabamento, relevo, classe_ad, variacao_tonalidade, n_faces, espessura, junta, m2_caixa, pecas_caixa)

res = []
sep = "\n"
for v in infos:
	res.append(
		header_list[0] + str(v[0]) + sep + 
		header_list[1] + str(v[1]) + sep +
		header_list[2] + str(v[2]) + sep +
		header_list[3] + str(v[3]) + sep +
		header_list[4] + str(v[4]) + sep +
		header_list[5] + str(v[5]) + sep +
		header_list[6] + str(v[6]) + sep +
		header_list[7] + str(v[7]) + sep +
		header_list[8] + str(v[8]) + sep +
		header_list[9] + str(v[9]) + sep +
		header_list[10] + str(v[10]) + sep +
		header_list[11] + str(v[11])
	)

OUT = res
# ----------------------------------------
setInformation = Orchid.RevitMaterial.AppearanceAsset.SetInformation(appearanceAsset=material_get_appearanceasset.AppearanceAsset, description=material_appenddescription, lacing=Longest)
